# Grasshopper definition Geometries.ghx (Grasshopper 1.0.7)
# plug-ins: LunchBox

number_slider = Slider(200, range=0..1000)
number_slider_2 = Slider(175, range=0..1000)

number_slider_3 = Slider(600, range=0..1000)
number_slider_4 = Slider(2, range=0..10)
rectangle = Rectangle(Plane=PlaneXY(0, 0, 0), XSize=number_slider_3, YSize=number_slider_3, Radius=0)  # -> Rectangle, Length
number_slider_5 = Slider(2, range=0..10)
diamond = DiamondPanels(Surface=rectangle.Rectangle, UDivisions=Slider(1, range=0..10), VDivisions=Slider(0, range=0..10))  # -> DiamondPanels, TriPanels
neg = Negative(Value=number_slider_4)
fillet = Fillet(Curve=diamond.DiamondPanels, Radius=number_slider_5)
fillet_2 = Fillet(Curve=diamond.TriPanels, Radius=number_slider_5)
merge = Merge(Data1=fillet, Data2=fillet_2)
offset = OffsetCurve(Curve=merge, Distance=neg, Plane=PlaneXY(0, 0, 0), Corners=1)

number_slider_6 = Slider(3, range=0..10)
number_slider_7 = Slider(3, range=0..10)
rectangle_2 = Rectangle(Plane=PlaneXY(0, 0, 0), XSize=number_slider_2, YSize=Slider(700, range=0..1000), Radius=0)  # -> Rectangle, Length
number_slider_8 = Slider(1, range=0..1)
squads = SkewedQuads(Surface=rectangle_2.Rectangle, UDivisions=Slider(1, range=0..10), VDivisions=Slider(3, range=0..10), TParameter=0)  # -> FullPanels, EdgePanels
number_slider_9 = Slider(3, range=0..10)
quads = QuadPanels(Surface=rectangle.Rectangle, UDivisions=number_slider_7, VDivisions=number_slider_7)
X = UnitX(Factor=expr("x*2", number_slider_2))
merge_2 = Merge(Data1=squads.FullPanels, Data2=squads.EdgePanels)
tria = TriangularPanelsA(Surface=rectangle.Rectangle, UDivisions=Slider(2, range=0..10), VDivisions=Slider(3, range=0..10))
tric = TrianglePanelsC(Surface=rectangle.Rectangle, UDivisions=number_slider_9, VDivisions=number_slider_9)
series = Series(Start=0, Step=1, Count=10)
mirror = Mirror(Geometry=merge_2, Plane=PlaneYZ(0, 0, 0))  # -> Geometry, Transform
offset_2 = OffsetCurve(Curve=rectangle.Rectangle, Distance=number_slider_4, Plane=PlaneXY(0, 0, 0), Corners=1)
panel = Panel("""2.2
4.4""")
merge_3 = Merge(Data1=merge_2, Data2=mirror.Geometry)
offset_3 = OffsetCurve(Curve=tric, Distance=neg, Plane=PlaneXY(0, 0, 0), Corners=1)
merge_4 = Merge(Data1=offset, Data2=offset_2)  # -> flatten(Result)
offset_4 = OffsetCurve(Curve=rectangle.Rectangle, Distance=panel, Plane=PlaneXY(0, 0, 0), Corners=1)
fillet_3 = Fillet(Curve=offset_3, Radius=Slider(3, range=0..10))
panel_2 = Panel("""3
3
3
3
-3
-3
-3
-3""")
offset_5 = OffsetCurve(Curve=merge_3, Distance=expr("-x", panel_2), Plane=PlaneXY(0, 0, 0), Corners=1)
arrlinear = LinearArray(Geometry=offset_5, Direction=X, Count=Slider(2, range=0..10))  # -> flatten(Geometry), Transform
area = Area(Geometry=arrlinear.Geometry)  # -> Area, Centroid
pdecon = Deconstruct(Point=area.Centroid)  # -> XComponent, YComponent, ZComponent
sort = SortList(Keys=pdecon.XComponent, ValuesA=arrlinear.Geometry)  # -> Keys, ValuesA
geo = Geometry(sort.ValuesA)
bbox = BoundingBox(Content=geo, Plane=PlaneXY(0, 0, 0), UnionBox=True)  # -> Box, Box_2
debrep = DeconstructBrep(Brep=bbox.Box)  # -> Faces, Edges, Vertices
item = ListItem(List=debrep.Faces, Index=0, Wrap=True)
debrep_2 = DeconstructBrep(Brep=item)  # -> Faces, Edges, Vertices
rectangle_3 = Rectangle(Plane=PlaneXY(0, 0, 0), XSize=Slider(500, range=0..1000), YSize=Slider(800, range=0..1000), Radius=0)  # -> Rectangle, Length
join = JoinCurves(Curves=debrep_2.Edges, Preserve=False)
offset_6 = OffsetCurve(Curve=join, Distance=Slider(6, range=0..10), Plane=PlaneXY(0, 0, 0), Corners=1)
layer_height = Slider(2, range=0..10)
layer_number = Slider(1, range=0..10)
merge_5 = Merge(Data1=flatten(offset_4), Data2=flatten(fillet_3))  # -> flatten(Result)
diamond_2 = DiamondPanels(Surface=rectangle_3.Rectangle, UDivisions=Slider(7, range=0..10), VDivisions=Slider(5, range=0..10))  # -> DiamondPanels, TriPanels
data = Data()

horizontal_count = Slider(1, range=0..10)
list = ValueList({"One": 1, "Two": 2, "Three": 2² - 1, "Four": Sqrt(16)}, selected="One")
data_2 = Data(geo)
crv = Curve(data_2)

geo_2 = Geometry(merge_5)
geo_3 = Geometry()
merge_6 = Merge(Data1=diamond_2.DiamondPanels, Data2=diamond_2.TriPanels)

horizontal_count_2 = Slider(1, range=0..10)
list_2 = ValueList({"One": 1, "Two": 2, "Three": 2² - 1, "Four": Sqrt(16)}, selected="One")
data_3 = Data(merge_6)
crv_2 = Curve(data_3)

neg_2 = Negative(Value=Slider(2.1, range=0..10))

layer_height_2 = Slider(2, range=0..10)
line_space = Slider(1.5, range=0..10)

offset_7 = OffsetCurve(Curve=merge_6, Distance=neg_2, Plane=PlaneXY(0, 0, 0), Corners=1)  # -> flatten(Curve)
cluster = Cluster(B_2=offset_7, A=layer_height, B=layer_number)
offset_8 = OffsetCurve(Curve=rectangle_3.Rectangle, Distance=Slider(1.5, range=0..10), Plane=PlaneXY(0, 0, 0), Corners=1)

# ----
# Export obj. to data
panel_3 = Panel("20210722_diamond_large_in.obj")
mjoin = MeshJoin(Meshes=cluster)
export_obj = GhPythonScript(export=Button(), mesh=mjoin, ObjName=panel_3)  # -> out, a; inputs mesh: Mesh
# ---------- export_obj: Python ----------
import os
import sys
import compas_rhino
from compas_rhino.geometry import RhinoMesh
import Rhino.Geometry as rg 


filepath = ghenv.Component.Attributes.Owner.OnPingDocument().FilePath
path = os.path.abspath(os.path.join(filepath, "..","data","3D_for_4D.obj"))
path_storage = os.path.abspath(os.path.join(filepath, "..", "..","obj",ObjName))

print (path_storage)
HERE = os.path.join(os.path.abspath(path)) 
HERE_storage = os.path.join(os.path.abspath(path_storage))

#######


if export:
    print(HERE)
    print(HERE_storage)
    c_mesh = RhinoMesh.from_geometry(mesh).to_compas()
    c_mesh.to_obj(HERE, None, True)
    c_mesh.to_obj(HERE_storage, None, True)
# ---------- end export_obj ----------

merge_7 = Merge(Data1=rectangle_3.Rectangle, Data2=offset_8)  # -> flatten(Result)

parameters_for_mesh = ParametersForMesh(
    data=line_space,
    data_2=layer_height_2,
    crv=crv_2,
    C_2=horizontal_count_2,
    A_2=list_2,
    crv_3=crv,
    C=horizontal_count,
    A=list)  # -> M_2, M
mesh = Mesh(parameters_for_mesh.M_2)
mesh_2 = Mesh(parameters_for_mesh.M)
merge_8 = Merge(Data1=mesh, Data2=mesh_2)  # -> flatten(Result)
geo_4 = Geometry(merge_8)
mjoin_2 = MeshJoin(Meshes=geo_4)
export_obj_2 = GhPythonScript(export=Button(), mesh=mjoin_2, ObjName="20210712_arrow_2.obj")  # -> out, a; inputs mesh: Mesh
# ---------- export_obj_2: Python ----------
import os
import sys
import compas_rhino
from compas_rhino.geometry import RhinoMesh
import Rhino.Geometry as rg 


filepath = ghenv.Component.Attributes.Owner.OnPingDocument().FilePath

#path is the main stream save .obj in the "data" folder for slicing

path = os.path.abspath(os.path.join(filepath, "..","data","3D_for_4D.obj"))

#path_storage is the main second saver to .obj in the "obj" folder for documentation
#change ObjName in the panel to not overwrite your archives .obj

path_storage = os.path.abspath(os.path.join(filepath, "..", "..","obj",ObjName))


print (path_storage)
HERE = os.path.join(os.path.abspath(path)) 
HERE_storage = os.path.join(os.path.abspath(path_storage))

#######


if export:
    print(HERE)
    c_mesh = RhinoMesh.from_geometry(mesh).to_compas()
    c_mesh.to_obj(HERE, None, True)
    c_mesh.to_obj(HERE_storage, None, True)
# ---------- end export_obj_2 ----------

# ==== cluster Cluster
A = ClusterInput()
B = ClusterInput()
multiplication = Multiplication(A=A, B=B)
B_2 = ClusterInput()
Z = UnitZ(Factor=expr("x-0.05", multiplication))
extr = Extrude(Base=B_2, Direction=Z)
rebsrf = RebuildSurface(Surface=extr, CountU=Slider(3, range=0..10), CountV=Slider(300, range=0..1000))
mjoin = MeshJoin(Meshes=rebsrf)
tri = Triangulate(Mesh=mjoin)  # -> Mesh, Count
M = ClusterOutput(tri.Mesh)

# ==== cluster ParametersForMesh
C = ClusterInput()
C_2 = ClusterInput()
data = ClusterInput()
data_2 = ClusterInput()
data_3 = Data(data)
data_4 = Data(data_2)
A = ClusterInput()
A_2 = ClusterInput()
crv = ClusterInput()

# ---- group: Edge Curves
multiplication = Multiplication(A=data_3, B=Slider(2, range=0..10))
multiplication_2 = Multiplication(A=A_2, B=data_4)
series = Series(Start=data_3, Step=multiplication, Count=C_2)
subtraction = Subtraction(A=multiplication_2, B=Slider(0.05, range=0..0.1))
crv_2 = Curve(crv)
Z = UnitZ(Factor=subtraction)
extr = Extrude(Base=crv_2, Direction=Z)
mesh = MeshBrep(
    Brep=extr,
    Settings={GridMaxCount=0, GridMinCount=16, JaggedSeams=False, MaxEdgeLength=0, MinEdgeLength=0.0001, MinTolerance=0, Refine=True, RefineAngle=0, RelativeTolerance=0.65, SimplePlanes=True, Tolerance=0})
tri = Triangulate(Mesh=mesh)  # -> Mesh, Count

# ----
crv_3 = ClusterInput()

# ---- group: Filler_Curves
multiplication_3 = Multiplication(A=data_3, B=Slider(2, range=0..10))
multiplication_4 = Multiplication(A=A, B=data_4)
series_2 = Series(Start=data_3, Step=multiplication_3, Count=C)
subtraction_2 = Subtraction(A=multiplication_4, B=Slider(0.05, range=0..0.1))
neg = Negative(Value=series_2)
crv_4 = Curve(crv_3)
Z_2 = UnitZ(Factor=subtraction_2)
extr_2 = Extrude(Base=crv_4, Direction=Z_2)
mesh_2 = MeshBrep(
    Brep=extr_2,
    Settings={GridMaxCount=0, GridMinCount=16, JaggedSeams=False, MaxEdgeLength=0, MinEdgeLength=0.0001, MinTolerance=0, Refine=True, RefineAngle=0, RelativeTolerance=0.65, SimplePlanes=True, Tolerance=0})
tri_2 = Triangulate(Mesh=mesh_2)  # -> Mesh, Count

# ----
M = ClusterOutput(tri_2.Mesh)
M_2 = ClusterOutput(tri.Mesh)
